# Grasshopper definition 190429 Machina Bridge.gh (Grasshopper 1.0.7)
# plug-ins: Machina, Firefly.Core

toolpath = Curve(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)

# ---- group: 6-Axis Motion (USE CAUTION)
# Exercise extreme caution when programming joint movements/6-axis
# movement. The robot may move unpredictably. The "TransformTo"
# component is your best bet for complex programs and provides the
# most control over the robot's TCP orientation.
# 
# Always test your program at extremely low speeds (<20mm/s) before
# executing faster.
perp_frames = PerpFrames(Curve=toolpath, Count=30, Align=True)  # -> simplify(graft(Frames)), Parameters
deconstruct_plane = DeconstructPlane(Plane=perp_frames.Frames)  # -> Origin, XAxis, YAxis, ZAxis
rotate_direction = RotateDirection(Geometry=perp_frames.Frames, Center=deconstruct_plane.Origin, From=deconstruct_plane.ZAxis, To=deconstruct_plane.XAxis)  # -> Geometry, Transform
flatten_tree = FlattenTree(Tree=rotate_direction.Geometry, Path="{0}")
transformto = TransformTo(Plane=flatten_tree, Relative=False)

# ----
customcode = CustomCode(IsDeclaration=False)
writeanalog = WriteAnalog(AnalogPin="1", Value=0, ToolPin=False)
toolpath_2 = Curve(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)

# ---- group: Binary Conversion Function
ghpython_script = GhPythonScript(steps="10", pulse_width="100")  # -> bool_list, num_chunks
# ---------- ghpython_script: Python ----------
"""Provides a scripting component.
    Inputs:
        steps: Steps motor will take
        pulse_width: Pulse width of each step (in microseconds)
    Output:
        bool_list: List of on/off commands for the 16 pins
        num_chunks: Number of times a command is sent out to the 16 pins"""

__author__ = "Kevin Guo"
__version__ = "2019.07.26"

BITS = 16
DELIMITER = -1
OFF = 0

#assumes pulse width will never overflow

def createCommands(stps,pulse):
    chunk_number = 0
    final_outputs = []

    cmd_list_steps,num_chunks_steps = interpretChunks(stps)
    cmd_list_delimeter = interpret(DELIMITER)
    cmd_list_pulse = interpret(pulse)
    cmd_list_off = interpret(OFF)\

    for i in range(num_chunks_steps):
        # adds step commands to outputs
        final_outputs.extend(cmd_list_steps[16*i:16*(i+1)])
        # adds delimeter commands to outputs
        final_outputs.extend(cmd_list_delimeter)
        # adds pulse width commands to outputs
        final_outputs.extend(cmd_list_pulse)
        final_outputs.extend(cmd_list_off)
        chunk_number += 4

    return final_outputs,chunk_number

def interpretChunks(number):
    # sets up default values of variables
    chunk_amount = 1
    chunks = []

    # splits the number into chunks
    if number > 32767:
        chunk_amount = int(number / 32767)
        for i in range(chunk_amount):
            chunks.append(32767)
        if number % 32767 > 0:
            chunks.append(number % 32767)
            chunk_amount += 1
    elif number < -32768:
        chunk_amount = int(number / -32768)
        for i in range(chunk_amount):
            chunks.append(-32768)
        if number % -32768 < 0:
            chunks.append(number % -32768)
            chunk_amount += 1
    else:
        chunks.append(number)

    output = []

    for i in range(chunk_amount):
        output.extend(interpret(chunks[i]))

    return output,chunk_amount

def interpret(num):
    out = [None] * BITS
    is_negative = False

    if num < 0:
        is_negative = True
        num = abs(num)

    binary = bin(num)[2:].zfill(BITS-1)

    for i in range(BITS-2,-1,-1):
        if int(binary[i]) == 1:
            out[BITS-2-i] = True
        else:
            out[BITS-2-i] = False
    if is_negative:
        out[BITS-1] = False
    else:
        out[BITS-1] = True
    return out

bool_list,num_chunks = createCommands(int(steps),int(pulse_width))
# ---------- end ghpython_script ----------
panel = Panel(ghpython_script.bool_list)

# ---- group: Standard 3 Axis Motion Using Robot Arm (No rotation of TCP in 3d space)
divide_curve = DivideCurve(Curve=toolpath_2, Count=Slider(26, range=0..50), Kinks=False)  # -> flatten(Points), Tangents, Parameters
moveto = MoveTo(Point=divide_curve.Points, Relative=False)  # -> simplify(flatten(Action))
speedto = SpeedTo(Speed="20", Relative=False)

# ---- group: Set Joint and Rotation Speeds
default_speed = Slider(0, range=0..100)
number_slider = Slider(5, range=1..30)
number_slider_2 = Slider(3, range=1..30)
number_slider_3 = Slider(5, range=1..30)
jointaccelerationto = JointAccelerationTo(JointAccelerationInc=default_speed, Relative=False)
rotationspeedto = RotationSpeedTo(RotationSpeedInc=default_speed, Relative=False)
jointspeedto = JointSpeedTo(JointSpeed=default_speed, Relative=False)

# ---- group: Relative Move
vector_xyz = VectorXYZ(XComponent=Slider(0, range=0..100), YComponent=Slider(0, range=0..100), ZComponent=Slider(40, range=0..100))  # -> Vector, Length
move = Move(Vector=vector_xyz.Vector, Relative=True)  # -> simplify(flatten(Action))
negative = Negative(Value=vector_xyz.Vector)

# ----
panel_2 = Panel(ghpython_script.num_chunks)
writedigital = WriteDigital(DigitalPin="DO10_1", On=Toggle(False), ToolPin=False)
writedigital_2 = WriteDigital(DigitalPin="DO10_1", On=Toggle(True), ToolPin=False)
wait = Wait(Time=1000)

# ---- group: Machina Bridge
reset = Button()
gate_not = GateNot(A=reset)
connect = Connect(URL="ws://127.0.0.1:7000/Bridge", Name="Grasshopper", Connect=gate_not)  # -> Messages, Bridge
panel_3 = Panel(connect.Messages)
panel_4 = Panel(connect.Bridge)

# ----
merge = Merge(Data1=writedigital, Data2=wait, Data3=writedigital_2)
writedigital_3 = WriteDigital(DigitalPin="1", On=False, ToolPin=False)
wait_2 = Wait(Time=1000)
number_slider_4 = Slider(8, range=0..10)
panel_5 = Panel(merge)
merge_2 = Merge(Data1=writedigital_3, Data2=wait_2)

send = Button()
send_2 = Send(Bridge=connect.Bridge, Actions=merge, Send=send)  # -> Sent, Instructions
panel_6 = Panel(send_2.Sent)
panel_7 = Panel(send_2.Instructions)

toggle = BooleanToggle(True)
open_port = OpenClosePort(OpenClosePort=toggle, PortNumber=number_slider_4, BaudRate="115200")
panel_8 = Panel(open_port)
timer = Timer(TimerInterval=10, Target=read)
read = SerialReadGeneric(StartReadingValues=toggle, PortNumber=number_slider_4)  # -> SerialOutput, StatusMessage
panel_9 = Panel(read.SerialOutput)

# ---- group: Sequence Generator
series = Series(Start=1, Step=1, Count=16)
duplicate_data = DuplicateData(Data=series, Number=ghpython_script.num_chunks, Order=True)

# ----
concatenate = Concatenate(FragmentA="D010_", FragmentB=duplicate_data)

# ---- group: Sequence Generator (continued)
writedigital_4 = WriteDigital(DigitalPin=concatenate, On=ghpython_script.bool_list, ToolPin=False)
partition_list = PartitionList(List=writedigital_4, Size=16)
panel_10 = Panel(partition_list)

# ----
panel_11 = Panel(concatenate)
panel_12 = Panel(writedigital_4)

# ---- group: Merge all of your actions here, in chronological order
merge_3 = Merge(Data1=speedto, Data2=moveto, Data3=writedigital_4)
